test file "AutopilotTestFile"
  setup callback:
    Simulink.fileGenControl('set', 'CacheFolder', tempdir,...
        'CodeGenFolder', tempdir);
  cleanup callback:
    Simulink.fileGenControl('reset');

suite "Basic Design Test Cases"

  case "Requirement 1.3 Test" [simulation]
    model RollAutopilotMdlRef, harness RollReference_Requirement1_3 (for RollAutopilotMdlRef/Roll Reference)
    custom criteria (off):
      % Return value: customCriteria
      % set customCriteria.out to true for pass and false for fail
      % set customCriteria.logs (cell array) for log messages
      % set customCriteria.errors (cell array) for error messages

      customCriteria.out = true;