test file "NoiseCancellation"

suite "NormalizedLMS"
  tags: lms

  case "snr" [baseline]
    tags: level1
    model audioanc_mabdemo, stop time 2
    post-load callback:
      % Turn on slow LMS adaptation - 0.002 step size
      set_param([sltest_sut '/Manual Switch1'], 'sw', '0')
      set_param([sltest_sut '/Manual Switch'], 'sw', '0')
    custom criteria:
      % Get the signal reference
      signalReference = sltest_simout.yout.get('signalReference').Values.Data(1,1,:);

      % Get the noise reference
      noiseReference  = sltest_simout.yout.get('noiseReference').Values.Data(1,1,:);

      % Compute the signal-to-noise ratio
      r = snr(signalReference, noiseReference);

      % Verify that SNR is atleast -14dB at the end of the simulation
      test.verifyLessThanOrEqual(r, single(-14), 'Expected SNR to be lower than -14dB');

  case "adapt" [baseline]
    tags: level2
    model audioanc_mabdemo, stop time 2
    custom criteria:
      % Get the signal reference
      signalReference = sltest_simout.yout.get('signalReference').Values.Data(1,1,:);

      % Get the noise reference
      noiseReference  = sltest_simout.yout.get('noiseReference').Values.Data(1,1,:);

      % SNR
      r = snr(signalReference, noiseReference);

      switch sltest_iterationName
          case 'adapt_off'
              % test.verifyEqual(r, single(-5.9579573), 'AbsTol', single(1e-3), 'SNR must be close to -6dB when adapt is off.');
              test.assumeEqual(r, single(-5.9579573), 'AbsTol', single(1e-3), 'SNR must be close to -6dB when adapt is off.');
          case 'adapt_slow'
              test.verifyGreaterThanOrEqual(r, single(-9), 'signal-to-ratio must be greater than -9dB with step size 0.002');
          case 'adapt_fast'
              test.verifyLessThanOrEqual(r, single(-15), 'signal-to-ratio must be lower than -15dB with step size 0.04');
      end
    iteration script:
      % Turn off LMS adaptation
      testItr = sltest.testmanager.TestIteration;
      setModelParam(testItr, [sltest_bdroot '/Manual Switch1'], 'sw', '1');
      setModelParam(testItr, [sltest_bdroot '/Manual Switch'], 'sw', '0'); % 0.04
      str = sprintf('%s', 'adapt_off');
      addIteration(sltest_testCase,testItr,str);

      % Turn on slow LMS adaptation - 0.002 step size
      testItr = sltest.testmanager.TestIteration;
      setModelParam(testItr, [sltest_bdroot '/Manual Switch'], 'sw', '1')
      setModelParam(testItr, [sltest_bdroot '/Manual Switch1'], 'sw', '0')
      str = sprintf('%s', 'adapt_slow');
      addIteration(sltest_testCase,testItr,str);

      % Turn on fast LMS adaptation - 0.04 step size
      testItr = sltest.testmanager.TestIteration;
      setModelParam(testItr, [sltest_bdroot '/Manual Switch'], 'sw', '0')
      setModelParam(testItr, [sltest_bdroot '/Manual Switch1'], 'sw', '0')
      str = sprintf('%s', 'adapt_fast');
      addIteration(sltest_testCase,testItr,str);