test file "sltestProjectorControlTests"

suite "Model baseline tests"
  setup callback:
    open_system(fullfile(matlabroot,'toolbox','simulinktest','simulinktestdemos','sltestProjectorController'));
    set_param('sltestProjectorController','SystemTargetFile','ert.tlc');
  cleanup callback:
    close_system('sltestProjectorController',0);

  case "Req_scenario_1" [baseline]
    model sltestProjectorController, harness Req_scenario_1
    post-load callback:
      set_param('Req_scenario_1','SystemTargetFile','ert.tlc');
    baseline "sltestProjectorCtrlData1.mat"
      fan_on
      fan_speed
      lamp_on

  case "Req_scenario_2" [baseline]
    model sltestProjectorController, harness Req_scenario_2
    post-load callback:
      set_param('Req_scenario_2','SystemTargetFile','ert.tlc');
    baseline "sltestProjectorCtrlData2.mat"
      fan_on
      fan_speed
      lamp_on

  case "Req_scenario_3" [baseline]
    model sltestProjectorController, harness Req_scenario_3
    post-load callback:
      set_param('Req_scenario_3','SystemTargetFile','ert.tlc');
    baseline "sltestProjectorCtrlData3.mat"
      fan_on
      fan_speed
      lamp_on

  case "Req_scenario_4" [baseline]
    model sltestProjectorController, harness Req_scenario_4
    post-load callback:
      set_param('Req_scenario_4','SystemTargetFile','ert.tlc');
    baseline "sltestProjectorCtrlData4.mat"
      fan_on
      fan_speed
      lamp_on